# Dynamo graph dimensions.dyn "dimensionsv2" (Dynamo 2.12.0.5650)

getItemAtIndex = List.GetItemAtIndex()  # unwired: list, index
all_elements_in_active_view = ElementsInView()
categories = Categories("OST_CLines")
all_elements_of_category = ElementsOfCategory(Category=categories)
indexOf = List.IndexOf(list=all_elements_in_active_view, element=all_elements_of_category)
function_apply = ApplyFunction(function=getItemAtIndex, argument0=all_elements_in_active_view, argument1=indexOf)
python_script = Python(IN[0]=function_apply)  # IronPython2
# ---------- python_script.python (9 lines) ----------
items = []
indices = []
for _ in range(0,len(IN[0])):
	if not IN[0][_] == None:
		items.append(IN[0][_])
	else:
		indices = _
		
OUT = items, indices
# ----------------------------------------
code_block = CodeBlock(a=python_script) { a[0]; }
plane = ReferencePlane.Plane(referencePlane=code_block)
count = List.Count(list=plane)
code_block_2 = CodeBlock(x=count) { x < 3; }
categories_2 = Categories("OST_Walls")
all_elements_of_category_2 = ElementsOfCategory(Category=categories_2)
indexOf_2 = List.IndexOf(list=all_elements_in_active_view, element=all_elements_of_category_2)
function_apply_2 = ApplyFunction(function=getItemAtIndex, argument0=all_elements_in_active_view, argument1=indexOf_2)
python_script_2 = Python(IN[0]=function_apply_2)  # IronPython2; same code as python_script
code_block_3 = CodeBlock(a=python_script_2) { a[0]; }
geometry = Element.Geometry(element=code_block_3)
intersect = Geometry.Intersect(geometry=geometry@L2, other=plane@@L1, lacing=CrossProduct)
getItemAtIndex_2 = List.GetItemAtIndex()  # unwired: list, index
normal = Plane.Normal(plane=plane)
X = Vector.X(vector=normal)
abs = Math.Abs(number=X)
code_block_4 = CodeBlock(x=abs) { x == 1; }
filterByBoolMask = List.FilterByBoolMask(list=abs, mask=code_block_4)
allIndicesOf = List.AllIndicesOf(list=abs, item=filterByBoolMask.in)
code_block_5 = CodeBlock { 0; }
function_apply_3 = ApplyFunction(function=getItemAtIndex_2, argument0=allIndicesOf, argument1=code_block_5)
function_apply_4 = ApplyFunction(function=getItemAtIndex_2, argument0=plane, argument1=function_apply_3)
intersect_2 = Geometry.Intersect(geometry=geometry@L2, other=function_apply_4, lacing=CrossProduct)
Y = Vector.Y(vector=normal)
abs_2 = Math.Abs(number=Y)
code_block_6 = CodeBlock(x=abs_2) { x == 1; }
filterByBoolMask_2 = List.FilterByBoolMask(list=abs_2, mask=code_block_6)
allIndicesOf_2 = List.AllIndicesOf(list=abs_2, item=filterByBoolMask_2.in)
function_apply_5 = ApplyFunction(function=getItemAtIndex_2, argument0=allIndicesOf_2, argument1=code_block_5)
function_apply_6 = ApplyFunction(function=getItemAtIndex_2, argument0=plane, argument1=function_apply_5)
intersect_3 = Geometry.Intersect(geometry=geometry@L2, other=function_apply_6, lacing=CrossProduct)
list_create = List.Create(item0=intersect_2, item1=intersect_3)
if_ = RefactoredIf(test=code_block_2, true=intersect, false=list_create)
transpose = List.Transpose(lists=if_@@L5)
clean = List.Clean(list=transpose)

# group: HV Splitter
code_block_7 = CodeBlock(a=clean) { a[0]; a[1]; }

code_block_8 = CodeBlock { 2; }
flatten = List.Flatten(list=code_block_7.out0@L4, amount=code_block_8)
code_block_9 = CodeBlock { [0,1]; 1; }
pointAtParameter = Surface.PointAtParameter(surface=flatten, u=code_block_9.out1, v=code_block_9.out0@L1)
transpose_2 = List.Transpose(lists=pointAtParameter)
code_block_10 = CodeBlock { 2; }
flatten_2 = List.Flatten(list=code_block_7.out1@L4, amount=code_block_10)
pointAtParameter_2 = Surface.PointAtParameter(surface=flatten_2, u=code_block_9.out1, v=code_block_9.out0@L1)
transpose_3 = List.Transpose(lists=pointAtParameter_2)
list_create_2 = List.Create(item0=transpose_2, item1=transpose_3)

# group: Put them on Same Z plane
XY = Plane.XY()
ZAxis = Vector.ZAxis()

code_block_11 = CodeBlock { view:var[]..[] = Revit.Application.Document.Current.ActiveView; }
python_script_3 = Python(IN[0]=code_block_11)  # IronPython2
# ---------- python_script_3.python (12 lines) ----------
import clr
clr.AddReference('RevitAPI')
from Autodesk.Revit.DB import View

def GetLevel(view) :
	if hasattr(view, "GenLevel") : return view.GenLevel
	else : return None

views = UnwrapElement(IN[0])

if isinstance(IN[0], list): OUT = [GetLevel(x) for x in views]
else: OUT = GetLevel(views)
# ----------------------------------------
code_block_12 = CodeBlock(Level=python_script_3) { Level; }
code_block_13 = CodeBlock { "Elevation"; }
getParameterValueByName = Element.GetParameterValueByName(element=code_block_12, parameterName=code_block_13)
offset = Plane.Offset(plane=XY, dist=getParameterValueByName)

# group (continued): Put them on Same Z plane
project = Point.Project(point=list_create_2, baseGeometry=offset, projectionDirection=ZAxis)

# group: HV Splitter
code_block_14 = CodeBlock(a=project) { a[0]; a[1]; }

flatten_3 = List.Flatten(list=code_block_14.out0@L4)

# group: Join & Sort Points
Y_2 = Point.Y()  # unwired: point
sortByFunction = List.SortByFunction(list=flatten_3@L2, sortFunction=Y_2)

pruneDuplicates = Point.PruneDuplicates(points=sortByFunction)
flatten_4 = List.Flatten(list=code_block_14.out1@L4)

# group: Join & Sort Points
X_2 = Point.X()  # unwired: point
sortByFunction_2 = List.SortByFunction(list=flatten_4@L2, sortFunction=X_2)

pruneDuplicates_2 = Point.PruneDuplicates(points=sortByFunction_2)
list_create_3 = List.Create(item0=pruneDuplicates, item1=pruneDuplicates_2)

# group: Remove First and Last Point
count_2 = List.Count(list=list_create_3@L2)
code_block_15 = CodeBlock(x=count_2) { x-1; }
removeItemAtIndex = List.RemoveItemAtIndex(list=list_create_3@L2, indices=code_block_15@L1)
code_block_16 = CodeBlock { 0; }
removeItemAtIndex_2 = List.RemoveItemAtIndex(list=removeItemAtIndex@L2, indices=code_block_16)

# group: Couple Them
code_block_17 = CodeBlock { 2; }
chop = List.Chop(list=removeItemAtIndex_2@L2, lengths=code_block_17)

# group: Get Start Point
code_block_18 = CodeBlock { 0; }
getItemAtIndex_3 = List.GetItemAtIndex(list=chop@@L2, index=code_block_18)

clean_2 = List.Clean(list=getItemAtIndex_3)

# group: Get End Point
code_block_19 = CodeBlock { 1; }
getItemAtIndex_4 = List.GetItemAtIndex(list=chop@@L2, index=code_block_19)

clean_3 = List.Clean(list=getItemAtIndex_4)

# group: Create Lines
byStartPointEndPoint = Line.ByStartPointEndPoint(startPoint=clean_2, endPoint=clean_3)

flatten_5 = List.Flatten(list=byStartPointEndPoint)
python_script_4 = Python(IN[0]=flatten_5)  # IronPython2
# ---------- python_script_4.python (56 lines) ----------
#Import required lybraries
import clr
clr.AddReference('RevitAPI')
from Autodesk.Revit.DB import *
clr.AddReference('RevitServices')
import RevitServices
from RevitServices.Persistence import DocumentManager
from RevitServices.Transactions import TransactionManager
doc = DocumentManager.Instance.CurrentDBDocument
clr.AddReference('RevitNodes')
import Revit
clr.ImportExtensions(Revit.Elements)
clr.ImportExtensions(Revit.GeometryConversion)
from Revit.Elements import *
clr.AddReference('ProtoGeometry')
from Autodesk.DesignScript.Geometry import *

#Data Entry
inNode0 = IN [0]
lineList = []
lineListRevitType=[]

#If more tham one element add it to a list
if isinstance(inNode0, list):
	lineList.extend(IN[0])
#if one element make it a 1 elemnt list tor the iterention works	
else:
	lineList.append(IN[0])
	lineList = UnwrapElement(lineList)
	lineListRevitType = []
#Iterate over Lines (list items), make it revit types to be used by the API 
for l in lineList:
	lineListRevitType.append(l.ToRevitType(True)) #line se llamaba
#Start the document transaction
TransactionManager.Instance.EnsureInTransaction(doc)

#Initialize the variables needed
detailCurveList = []
line_List = []
referencesList = []
dimensions = []
u=[]
#Iterate over the lineList(revit elements) to create the dimentions from it's reference points (Start and End points):
for i in range(len(lineList)): #detail_curve
	detailCurveList.append(doc.Create.NewDetailCurve(doc.ActiveView, lineListRevitType[i]))
	line_List.append(UnwrapElement(detailCurveList[i]).GeometryCurve)
	referencesList.append(ReferenceArray())
	referencesList[i].Append(UnwrapElement(line_List[i]).GetEndPointReference(0))
	referencesList[i].Append(UnwrapElement(line_List[i]).GetEndPointReference(1))
	dimensions.append(doc.Create.NewDimension(doc.ActiveView, lineListRevitType[i], referencesList[i]))
	u.append(i)
#Close Document transaction

TransactionManager.Instance.TransactionTaskDone() 

OUT = dimensions
# ----------------------------------------
python_script_5 = Python(IN[0]=code_block, IN[1]=python_script_4)  # IronPython2
# ---------- python_script_5.python (31 lines) ----------
import clr
import sys
import System
clr.AddReference('ProtoGeometry')
from Autodesk.DesignScript.Geometry import *

clr.AddReference('RevitAPI')
import Autodesk
from Autodesk.Revit.DB import *

from System.Collections.Generic import List

clr.AddReference('RevitServices')
import RevitServices
from RevitServices.Persistence import DocumentManager
from RevitServices.Transactions import TransactionManager
doc = DocumentManager.Instance.CurrentDBDocument

toList = lambda x : x if hasattr(x, '__iter__') else [x]
# Place your code below this line
lst_elements = toList(UnwrapElement(IN[0]))
lst_elementIds = List[ElementId]([x.Id for x in lst_elements])

TransactionManager.Instance.EnsureInTransaction(doc)
if IN[1] != None:
	doc.Delete(lst_elementIds)
TransactionManager.Instance.TransactionTaskDone()

OUT = lst_elementIds
# Assign your output to the OUT variable.
OUT = 0
# ----------------------------------------
